# Grasshopper definition Code_0.gh (Grasshopper 1.0.7)
# plug-ins: LunchBoxML

number_slider = Slider(12, range=0..100)
# Machine Learning (High-Level Programming)
panel = Panel("""0
1
2
3
4
5""")
panel_2 = Panel("""1
3
5
7
9
11""")
# Traditional Programming (Low-Level Programming)
panel_3 = Panel("""0
1
2
3
4
5""")
panel_4 = Panel("2 * x + 1")
c_script = CSharpScript(x=number_slider)  # -> out, A; inputs x: Double
# ---------- c_script: C# ----------
    A = 2 * x + 1;
# ---------- end c_script ----------
panel_5 = Panel(c_script.A)
linereg = LinearRegression(TestData=number_slider, TrainingInputs=panel, TrainingOutput=panel_2, RandomSeed=5)
panel_6 = Panel(linereg)
