# Grasshopper definition Code_1.gh (Grasshopper 1.0.7)
# plug-ins: Crow

dom = ConstructDomain(DomainStart=Slider(-12.57, range=-15..15), DomainEnd=Slider(9.45, range=-15..15))
rec = Rectangle({Plane=PlaneXY(-158.3839671, -129.916081, 0), Size=Domain2(u=-509.3177163..509.3177163, v=-469.0400398..469.0400398)})
pop2d = Populate2D(Region=rec, Count=Slider(28, range=0..100), Seed=1)
lng = ListLength(List=pop2d)
random = Random(Range=dom, Number=lng, Seed=Slider(24523, range=0..100000))
multiplication = Multiplication(A=random, B=Slider(20.22, range=0..100))
Z = UnitZ(Factor=multiplication)
move = Move(Geometry=pop2d, Motion=Z)  # -> Geometry, Transform
toggle = BooleanToggle(False)
plfit = PlaneFit(Points=move.Geometry)  # -> Plane, Deviation
som_2d = CrowNetConstructorSelfOrganizingMap2D(
    LayerWidth=Slider(60, range=0..100),
    LayerHeight=Slider(60, range=0..100),
    CircularRows=toggle,
    CircularColumns=toggle,
    LatticeTopology=toggle,
    NeighborhoodFunction=False,
    LearningRate=Slider(0.95, range=0..1))
jitter = Jitter(List=move.Geometry, Jitter=1, Seed=2)  # -> Values, Indices
rectangle = Rectangle(Plane=plfit.Plane, XSize=Slider(72, range=0..100), YSize=Slider(78, range=0..100), Radius=0)  # -> Rectangle, Length
mplane = MeshPlane(Boundary=rectangle.Rectangle, WidthCount="40", HeightCount="40")  # -> Mesh, Area
demesh = DeconstructMesh(Mesh=mplane.Mesh)  # -> Vertices, Faces, Colours, Normals
addition = Addition(A="40", B=1)
partition = PartitionList(List=demesh.Vertices, Size=addition)
crow_som_2d = CrowEngineSelfOrganizingMaps2D(
    TrainingCycles=Slider(1500, range=0..10000),
    CrowNetSOM2D=som_2d,
    Points=jitter.Values,
    TrainginVectors=partition,
    Go=Toggle(False))  # -> TrainingCycles, CrowNet
som_2d_mesh = _2DSOMMeshDisplay(CrowNet=crow_som_2d.CrowNet)
som_2d_grid = _2DSOMGridDisplay(CrowNet=crow_som_2d.CrowNet)  # -> GridRows, GridColumns, HexagonalRows
