# Grasshopper definition Code_2.gh (Grasshopper 1.0.7)
# plug-ins: Crow, MeshEdit Components

number_slider = Slider(10, range=0..10)
dom = ConstructDomain(DomainStart=Slider(-419.35, range=-500..500), DomainEnd=Slider(200.95, range=-500..500))
random = Random(Range=dom, Number="3", Seed=Slider(357, range=0..1000), Integers=True)
random_2 = Random(Range=dom, Number="3", Seed=Slider(405, range=0..1000), Integers=True)
abs = Absolute(Value=random)
abs_2 = Absolute(Value=random_2)
dom_2 = ConstructDomain(DomainStart=Slider(3.57, range=-100..100), DomainEnd=Slider(13.24, range=-100..100))
panel = Panel("""10
10
10""")
item = ListItem(List=abs, Index=0, Wrap=True)  # -> Item, Item1, Item2
item_2 = ListItem(List=abs_2, Index=0, Wrap=True)  # -> Item, Item1, Item2
random_3 = Random(Range=dom, Number=number_slider, Seed=item_2.Item)
random_4 = Random(Range=dom, Number=number_slider, Seed=item_2.Item1)
random_5 = Random(Range=dom, Number=number_slider, Seed=item_2.Item2)
random_6 = Random(Range=dom, Number=number_slider, Seed=item.Item2)
random_7 = Random(Range=dom_2, Number=number_slider, Seed=item_2.Item2, Integers=True)
random_8 = Random(Range=dom, Number=number_slider, Seed=item.Item1)
random_9 = Random(Range=dom, Number=number_slider, Seed=item.Item)
random_10 = Random(Range=Domain(0, 1), Number=number_slider, Seed=item_2.Item2, Integers=False)
sog = CrowNetConstructorSelfOrganizingGridGeneric(LayerDimensions=panel, NeighborhoodFunction=False, LearningRate=Slider(0.95, range=0..1))
pt = ConstructPoint(XCoordinate=random_9, YCoordinate=random_8, ZCoordinate=random_6)
vec = VectorXYZ(XComponent=random_3, YComponent=random_4, ZComponent=random_5)  # -> Vector, Length
number_slider_2 = Slider(9.702, range=0..100)
pl = ConstructPlane(Origin=pt, XAxis=vec.Vector, YAxis=Vector(0, 1, 0))
number_slider_3 = Slider(12, range=0..100)
box = CenterBox(Base=pl, X=number_slider_2, Y=number_slider_2, Z=number_slider_2)
entwine = Entwine(
    Branch00=random_9,
    Branch01=random_8,
    Branch02=random_6,
    Branch03=random_3,
    Branch04=random_4,
    Branch05=random_5,
    Branch06=random_7,
    Branch07=random_10,
    FlattenInputs=True)
hsl = ColourHSL(Alpha=1, Hue=random_10, Saturation=1, Luminance=0.5)
pop3d = Populate3D(Region=box, Count=random_7, Seed=Slider(338, range=0..1000))
flip = FlipMatrix(Data=entwine)
convexhull = _3DConvexHull(Points=pop3d)  # -> graft(ConvexHullSurface)
mcol = MeshColours(Mesh=convexhull, Colours=graft(hsl))
crow_sog = CrowEngineSelfOrganizingGridsGeneric(TrainingCycles=Slider(6000, range=0..10000), CrowNetSOG=sog, TrainingVectors=flip, Start=Toggle(False))  # -> TrainingCyclesAndTiming, CrowNet
panel_2 = Panel("""0
1
2""")
panel_3 = Panel(crow_sog.TrainingCyclesAndTiming)
sog_data = GenericSOGDisplay(CrowNet=crow_sog.CrowNet, XYZDimensionIndicesOptional=panel_2)  # -> DataVectors, Points, AdressStructure, WinnerIndex
sog_lines = GenericSOGLineDisplay(CrowNet=crow_sog.CrowNet, XYZDimensionIndicesOptional=[0, 1, 2], TopologyDimensionIndicesOptional=[0, 1, 2])  # -> _1st, _2nd, _3rd
panel_4 = Panel("""1
1
1""")
data_picker = GenericSOGDataPicker(DataVectors=sog_data.DataVectors, Indices=panel_4)  # -> DataVectors, Paths
item_3 = ListItem(List=data_picker.DataVectors, Index=0, Wrap=True)  # -> flatten(Item), flatten(Item1), flatten(Item2), flatten(Item3), flatten(Item4), flatten(Item5), flatten(Item6), flatten(Item7)
pt_2 = ConstructPoint(XCoordinate=item_3.Item, YCoordinate=item_3.Item1, ZCoordinate=item_3.Item2)
vec_2 = VectorXYZ(XComponent=item_3.Item3, YComponent=item_3.Item4, ZComponent=item_3.Item5)  # -> Vector, Length
pl_2 = ConstructPlane(Origin=pt_2, XAxis=vec_2.Vector, YAxis=Vector(0, 1, 0))
box_2 = CenterBox(Base=pl_2, X=number_slider_2, Y=number_slider_2, Z=number_slider_2)
pop3d_2 = Populate3D(Region=box_2, Count=item_3.Item6, Seed=1)
hsl_2 = ColourHSL(Alpha=1, Hue=item_3.Item7, Saturation=1, Luminance=0.5)
convexhull_2 = _3DConvexHull(Points=pop3d_2)
mcol_2 = MeshColours(Mesh=convexhull_2, Colours=graft(hsl_2))
