# Grasshopper definition Code_3.gh (Grasshopper 1.0.7)
# plug-ins: LunchBoxML

panel = Panel("""WC
Room<Zone>
Studio
Meduim Apartment
Big Apartment""")
crv = Curve([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])
pipeline = GeometryPipeline(
    GroupByLayer=False,
    GroupByType=False,
    IncludeHidden=True,
    IncludeLocked=True,
    LayerFilter="Sam",
    NameFilter="*",
    SublayerFiltering=True,
    TypeFilter=4)
test = Curve(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)
bbox = BoundingBox(Content=crv, Plane=PlaneXY(0, 0, 0))  # -> Box, Box_2
area = Area(Geometry=crv)  # -> Area, Centroid
debox = DeconstructBox(Box=bbox.Box)  # -> Plane, X, Y, Z
srf = Surface(bbox.Box)
lng = ListLength(List=area.Area)
area_2 = Area(Geometry=pipeline)  # -> Area, Centroid
bbox_2 = BoundingBox(Content=pipeline, Plane=PlaneXY(0, 0, 0))  # -> Box, Box_2
dup = DuplicateData(Data=graft(panel), Number=Slider(6, range=0..10), Order=True)  # -> flatten(Labels)
dim = Dimensions(Surface=srf)  # -> UDimension, VDimension
dedomain = DeconstructDomain(Domain=debox.X)  # -> Start, End
dedomain_2 = DeconstructDomain(Domain=debox.Y)  # -> Start, End
series = Series(Start=0, Step=1, Count=lng)
srf_2 = Surface(bbox_2.Box)
subtraction = Subtraction(A=dedomain.End, B=dedomain.Start)
subtraction_2 = Subtraction(A=dedomain_2.End, B=dedomain_2.Start)
panel_2 = Panel(area_2.Area)
dim_2 = Dimensions(Surface=srf_2)  # -> UDimension, VDimension
areas = Panel(area.Area)
length = Panel(subtraction)
bnd = Bounds(Numbers=area.Area)
remap = RemapNumbers(Value=area_2.Area, Source=bnd, Target=Domain(0, 1))  # -> Mapped, Clipped
bnd_2 = Bounds(Numbers=subtraction)
remap_2 = RemapNumbers(Value=dim_2.UDimension, Source=bnd_2, Target=Domain(0, 1))  # -> Mapped, Clipped
bnd_3 = Bounds(Numbers=subtraction_2)
remap_3 = RemapNumbers(Value=dim_2.VDimension, Source=bnd_3, Target=Domain(0, 1))  # -> Mapped, Clipped
width = Panel(subtraction_2)
entwine = Entwine(Branch00=remap.Mapped, Branch01=remap_2.Mapped, Branch02=remap_3.Mapped, FlattenInputs=True)
tag = TextTag3D(Location=area.Centroid, Text=dup, Size=Slider(0.657, range=0..1), Justification=5)
remap_4 = RemapNumbers(Value=area.Area, Source=bnd, Target=Domain(0, 1))  # -> Mapped, Clipped
remap_5 = RemapNumbers(Value=subtraction, Source=bnd_2, Target=Domain(0, 1))  # -> Mapped, Clipped
remap_6 = RemapNumbers(Value=subtraction_2, Source=bnd_3, Target=Domain(0, 1))  # -> Mapped, Clipped
flip = FlipMatrix(Data=entwine)
entwine_2 = Entwine(Branch00=remap_4.Mapped, Branch01=remap_5.Mapped, Branch02=remap_6.Mapped, FlattenInputs=True)
flip_2 = FlipMatrix(Data=entwine_2)
path = FilePath("C:\Users\samra\Desktop\Workshop\Session1\assets\Code_3_model.bin")
neural_network_trainer = NeuralNetworkTrainer(
    TrainingInputs=flip_2,
    TrainingOutputs=simplify(graft(series)),
    HiddenNeurons=Slider(5, range=0..10),
    LearningAlgorithm=1,
    ActivationFunction=3,
    Alpha=Slider(0.91, range=0..1),
    Iterations=Slider(2569, range=0..10000))  # -> TrainedNueralNetwork, ErrorsDynamics
load_model = LoadModel(FilePath=path)
neural_network_tester = NeuralNetworkTester(TrainedNeuralNetwork=neural_network_trainer.TrainedNueralNetwork, TestInputData=flip)
panel_3 = Panel(neural_network_trainer.ErrorsDynamics)
round = Round(Number=neural_network_tester)  # -> Nearest, Floor, Ceiling
item = ListItem(List=dup, Index=flatten(round.Nearest), Wrap=True)
tag_2 = TextTag3D(Location=area_2.Centroid, Text=item, Size=1, Justification=5)
panel_4 = Panel(round.Nearest)
