# Grasshopper definition Code_4.gh (Grasshopper 1.0.7)
# plug-ins: LunchBoxML, Bifocals

dataset_apartments = Geometry([<geometrygroup referenced from the Rhino model> x41])
lng = ListLength(List=dataset_apartments)
ungroup = Ungroup(Group=dataset_apartments)
series = Series(Start=0, Step=1, Count=lng)
bbox = BoundingBox(Content=ungroup, Plane=PlaneXY(0, 0, 0), UnionBox=True)  # -> Box, Box_2

geo = Geometry([<curve referenced from the Rhino model> x158])
group = Group(Objects=geo)
rec = DataRecorder(group, DataLimit=-10, RecordData=False)
grp = Group(rec)
panel = Panel(grp)

srf = Surface(bbox.Box)
entrances = Point([Point(-52.92197695, 56.12526408, 0), Point(-55.55800165, 53.97133837, 0), Point(-52.9241264, 45.45388222, 0), Point(-55.60862786, 31.46762566, 0), Point(-52.68266761, 29.43721624, 0), Point(-54.82300152, 15.42335947, 0)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])
crv_cp = CurveClosestPoint(Point=graft(entrances), Curve=reparameterize(srf))  # -> Point, Parameter, Distance
dim = Dimensions(Surface=srf)  # -> flatten(UDimension), flatten(VDimension)
area = Area(Geometry=srf)  # -> flatten(Area), Centroid
srf_cp = SurfaceClosestPoint(Point=crv_cp.Point, Surface=reparameterize(srf))  # -> Point, UVPoint, Distance
pdecon = Deconstruct(Point=flatten(srf_cp.UVPoint))  # -> XComponent, YComponent, ZComponent
bnd = Bounds(Numbers=area.Area)
bnd_2 = Bounds(Numbers=dim.VDimension)
bnd_3 = Bounds(Numbers=dim.UDimension)
remap = RemapNumbers(Value=dim.VDimension, Source=bnd_2, Target=Domain(0, 1))  # -> Mapped, Clipped
remap_2 = RemapNumbers(Value=area.Area, Source=bnd, Target=Domain(0, 1))  # -> Mapped, Clipped
remap_3 = RemapNumbers(Value=dim.UDimension, Source=bnd_3, Target=Domain(0, 1))  # -> Mapped, Clipped
pipeline = GeometryPipeline(
    GroupByLayer=False,
    GroupByType=False,
    IncludeHidden=True,
    IncludeLocked=True,
    LayerFilter="Sam",
    NameFilter="*",
    SublayerFiltering=True,
    TypeFilter=4)
pipeline_2 = GeometryPipeline(
    GroupByLayer=False,
    GroupByType=False,
    IncludeHidden=True,
    IncludeLocked=True,
    LayerFilter="Sam",
    NameFilter="*",
    SublayerFiltering=True,
    TypeFilter=1)
entwine = Entwine(
    Branch00=remap_2.Mapped,
    Branch01=remap_3.Mapped,
    Branch02=remap.Mapped,
    Branch03=pdecon.XComponent,
    Branch04=pdecon.YComponent,
    FlattenInputs=True)
flip = FlipMatrix(Data=entwine)
bbox_2 = BoundingBox(Content=pipeline, Plane=PlaneXY(0, 0, 0))  # -> Box, Box_2
srf_2 = Surface(bbox_2.Box)
neural_network_trainer = NeuralNetworkTrainer(
    TrainingInputs=flip,
    TrainingOutputs=graft(series),
    HiddenNeurons=Slider(30, range=0..100),
    LearningAlgorithm=1,
    ActivationFunction=5,
    Alpha=2,
    Iterations=Slider(23254, range=0..100000))  # -> TrainedNueralNetwork, ErrorsDynamics
dim_2 = Dimensions(Surface=srf_2)  # -> UDimension, VDimension
area_2 = Area(Geometry=srf_2)  # -> Area, Centroid
crv_cp_2 = CurveClosestPoint(Point=pipeline_2, Curve=reparameterize(srf_2))  # -> Point, Parameter, Distance
panel_2 = Panel(area_2.Area)
srf_cp_2 = SurfaceClosestPoint(Point=crv_cp_2.Point, Surface=reparameterize(srf_2))  # -> Point, UVPoint, Distance
remap_4 = RemapNumbers(Value=dim_2.UDimension, Source=bnd_3, Target=Domain(0, 1))  # -> Mapped, Clipped
remap_5 = RemapNumbers(Value=dim_2.VDimension, Source=bnd_2, Target=Domain(0, 1))  # -> Mapped, Clipped
remap_6 = RemapNumbers(Value=area_2.Area, Source=bnd, Target=Domain(0, 1))  # -> Mapped, Clipped
pdecon_2 = Deconstruct(Point=srf_cp_2.UVPoint)  # -> XComponent, YComponent, ZComponent
entwine_2 = Entwine(
    Branch00=remap_6.Mapped,
    Branch01=remap_4.Mapped,
    Branch02=remap_5.Mapped,
    Branch03=pdecon_2.XComponent,
    Branch04=pdecon_2.YComponent,
    FlattenInputs=True)
flip_2 = FlipMatrix(Data=entwine_2)
neural_network_tester = NeuralNetworkTester(TrainedNeuralNetwork=neural_network_trainer.TrainedNueralNetwork, TestInputData=flip_2)
round = Round(Number=neural_network_tester)  # -> Nearest, Floor, Ceiling
item = ListItem(List=dataset_apartments, Index=round.Nearest, Wrap=True)
bbox_3 = BoundingBox(Content=item, Plane=PlaneXY(0, 0, 0))  # -> Box, Box_2
area_3 = Area(Geometry=bbox_3.Box)  # -> Area, Centroid
orient = Orient(Geometry=item, Source=area_3.Centroid, Target=area_2.Centroid)  # -> Geometry, Transform
