# Grasshopper definition Code_5.gh (Grasshopper 1.0.7)
# plug-ins: LunchBox, Anemone, Bifocals

brep = Brep(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)  # disabled
number_slider = Slider(1, range=0..1)  # disabled
debrep = DeconstructBrep(Brep=brep)  # -> Faces, Edges, Vertices; disabled
trisub = SubdivideTriangle(
    TriangularCurve=debrep.Faces,
    Subdivide=number_slider,
    Boolean1=True,
    Boolean2=True,
    Boolean3=True,
    Boolean4=True,
    Wires=True)  # -> TriangleCellsA, TriangleCellsB; disabled
brep_2 = Brep(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)
panel = Panel("0")  # disabled
cull_i = CullIndex(List=trisub.TriangleCellsA, Indices=panel, Wrap=True)  # disabled
loop_start = LoopStart(Repeat=Slider(1, range=0..10), Trigger=Button(), Data=brep_2)  # -> port, Counter, Data
boundary = BoundarySurfaces(Edges=cull_i)  # -> flatten(Surfaces); disabled
debrep_2 = DeconstructBrep(Brep=loop_start.Data)  # -> Faces, Edges, Vertices
join = BrepJoin(Breps=boundary)  # -> Breps, Closed; disabled
trisub_2 = SubdivideTriangle(TriangularCurve=debrep_2.Faces, Subdivide="1", Boolean1=True, Boolean2=True, Boolean3=True, Boolean4=True, Wires=True)  # -> TriangleCellsA, TriangleCellsB
cap = CapHoles(Brep=join.Breps)  # -> graft(Brep); disabled
number_slider_2 = Slider(1, range=0..1)  # disabled
debrep_3 = DeconstructBrep(Brep=cap)  # -> Faces, Edges, Vertices; disabled
cull_i_2 = CullIndex(List=trisub_2.TriangleCellsA, Indices=0, Wrap=True)
boundary_2 = BoundarySurfaces(Edges=cull_i_2)  # -> flatten(Surfaces)
trisub_3 = SubdivideTriangle(
    TriangularCurve=debrep_3.Faces,
    Subdivide=number_slider_2,
    Boolean1=True,
    Boolean2=True,
    Boolean3=True,
    Boolean4=True,
    Wires=True)  # -> TriangleCellsA, TriangleCellsB; disabled
join_2 = BrepJoin(Breps=boundary_2)  # -> Breps, Closed
panel_2 = Panel("0")  # disabled
cap_2 = CapHoles(Brep=join_2.Breps)  # -> graft(Brep)
cull_i_3 = CullIndex(List=trisub_3.TriangleCellsA, Indices=panel_2, Wrap=True)  # disabled
loop_end = LoopEnd(port=loop_start.port, Exit=False, Data=cap_2, TimeOutVal=0, pausedState=False, state="Output last")
boundary_3 = BoundarySurfaces(Edges=cull_i_3)  # -> flatten(Surfaces); disabled
join_3 = BrepJoin(Breps=boundary_3)  # -> Breps, Closed; disabled
