# Grasshopper definition Code_6.gh (Grasshopper 1.0.7)

number_slider = Slider(100, range=0..100)
number_slider_2 = Slider(384, range=0..1000)
sph = Sphere(Base=PlaneXY(0, 0, 0), Radius=Slider(1, range=0..10))
sdivide = DivideSurface(Surface=sph, UCount=number_slider, VCount=number_slider)  # -> flatten(Points), Normals, Parameters
c_script = CSharpScript(scale=Slider(9, range=0..10), n=Slider(8, range=0..10), iPoint=sdivide.Points)  # -> out, B, A; inputs scale: Int32, n: Double, iPoint: list of Point3d
# ---------- c_script: C# ----------
    List<Vector3d> vec = new List<Vector3d>();


    for (int i = 0;i < iPoint.Count;i++)
    {
      vec.Add(new Vector3d(iPoint[i].X, iPoint[i].Y, iPoint[i].Z));
    }

    List<double> r = new List<double>();
    List<Point3d> cpt = new List<Point3d>(iPoint);



    for (int i = 0;i < scale;i++)
    {
      foreach (Vector3d v in vec)
        r.Add(v.Length);

      for(int j = 0;j < vec.Count;j++)
      {
        double phi = Math.Atan2(vec[j].Y, vec[j].X);
        double theta = Math.Atan2(Math.Sqrt(vec[j].X * vec[j].X + vec[j].Y * vec[j].Y), vec[j].Z);
        double vr = Math.Pow(r[j], n);
        double vx = Math.Sin(n * theta) * Math.Cos(n * phi);
        double vy = Math.Sin(n * theta) * Math.Sin(n * phi);
        double vz = Math.Cos(n * theta);
        vec[j] = new Vector3d(vx, vy, vz) * vr + (Vector3d) cpt[j];
        cpt[j] += vec[j];
      }

    }
    A = vec;
    B = cpt;
# ---------- end c_script ----------
