# Grasshopper definition GAN.gh (Grasshopper 1.0.7)
# plug-ins: Pug, Owl.GH, Bifocals

plane_surface = PlaneSurface(Plane=PlaneXY(0, 0, 0), XSize=Domain(-10, 10), YSize=Domain(-10, 10))

# ---- group: First Button
button = Button()

# ----
colour_rgb = ColourRGB(Alpha=255, Red=0, Green=0, Blue=0)

# ---- group: Latent Dim
number_slider = Slider(100, range=0..100)

# ----
panel = Panel("""28
28
1""")
mnist = MNISTDatabase(Run=button)  # -> XTrain, YTrain, XTest, YTest
custom_preview = CustomPreview(
    Geometry=plane_surface,
    Material={diffuse=RGB(221, 160, 221), emission=RGB(66, 48, 66), shine=0.5, specular=RGB(255, 255, 255), transparency=0})
panel_2 = Panel(mnist.XTrain)
operations = TensorOperations(Tensor=mnist.XTrain, Values="127.5", mode="Tensor Division")
cluster = Cluster_2(int_3=number_slider, int=panel)
cluster_2 = Cluster(int=panel)
operations_2 = TensorOperations(Tensor=operations, Values="1", mode="Tensor Substraction")
panel_3 = Panel("""28
28
1""")
tensor = ReshapeTensor(Tensor=operations_2, Shape=panel_3)

# ---- group: Second Button
button_2 = Button()

# ----
file_path = FilePath("C:\Users\samra\Desktop\New folder\")
gan = GANAgent(Run=button_2, X=tensor, Generator=cluster, Discriminator=cluster_2, Path=file_path, BatchSize="64", Epochs="1000")  # -> Agent, GeneratorLoss, DiscriminatorLoss

# ---- group: Try different seeds
number_slider_2 = Slider(475, range=0..1000)

# ----
random = Random(Range=Domain(0, 1), Number=number_slider, Seed=number_slider_2)
graph = GraphMapper(random, x0=0, x1=1, y0=0, y1=1, container_name="Sine", Equation_px=[0, 0.5474367142], Equation_py=[0, 1])
tensor_2 = ConstructTensor(Values=flatten(graph), Shape="100")
generate = GANGenerateImage(Agent=gan.Agent, X=tensor_2)
# The great plugin "Owl" can be used to visualize tensors.
tensor_3 = DeconstructTensor(Tensor=generate)  # -> Values, Shape, BatchDimension
tensor_4 = ConstructTensor(Values=tensor_3.Values)
cull_i = CullIndex(List=tensor_3.Shape, Indices="-1", Wrap=True)
reshape = Reshape(Tensor=tensor_4, Shape=cull_i)
_2dpreview = Tensor2DPreview(Tensor=reshape, Range="-1 to 1", SaveAll=False)

# ==== cluster Cluster
int = ClusterInput()
int_2 = Integer(int)
keras_layer = KerasLayer(Shape=int_2, mode="Input Layer")
panel = Panel("""2
2""")
panel_2 = Panel("""3
3""")
list = ValueList({"valid": 0, "same": 1}, selected="same")
keras_layer_2 = KerasLayer(Parent=keras_layer, Filters="128", Kernel=panel_2, Stride=panel, Padding=list, mode="Conv2D Layer")
keras_layer_3 = KerasLayer(Parent=keras_layer_2, Alpha="0.2", mode="LeakyReLU Layer")
keras_layer_4 = KerasLayer(Parent=keras_layer_3, Momentum="0.8", mode="Batch Normalization Layer")
panel_3 = Panel("""3
3""")
list_2 = ValueList({"valid": 0, "same": 1}, selected="same")
panel_4 = Panel("""2
2""")
keras_layer_5 = KerasLayer(Parent=keras_layer_4, Filters="256", Kernel=panel_3, Stride=panel_4, Padding=list_2, mode="Conv2D Layer")
keras_layer_6 = KerasLayer(Parent=keras_layer_5, Momentum="0.8", mode="Batch Normalization Layer")
keras_layer_7 = KerasLayer(Parent=keras_layer_6, Alpha="0.2", mode="LeakyReLU Layer")
panel_5 = Panel("""3
3""")
list_3 = ValueList({"valid": 0, "same": 1}, selected="same")
panel_6 = Panel("""2
2""")
keras_layer_8 = KerasLayer(Parent=keras_layer_7, Filters="512", Kernel=panel_5, Stride=panel_6, Padding=list_3, mode="Conv2D Layer")
keras_layer_9 = KerasLayer(Parent=keras_layer_8, Momentum="0.8", mode="Batch Normalization Layer")
keras_layer_10 = KerasLayer(Parent=keras_layer_9, Alpha="0.2", mode="LeakyReLU Layer")
panel_7 = Panel("""3
3""")
list_4 = ValueList({"valid": 0, "same": 1}, selected="same")
panel_8 = Panel("""2
2""")
keras_layer_11 = KerasLayer(Parent=keras_layer_10, Filters="1024", Kernel=panel_7, Stride=panel_8, Padding=list_4, mode="Conv2D Layer")
keras_layer_12 = KerasLayer(Parent=keras_layer_11, Momentum="0.8", mode="Batch Normalization Layer")
keras_layer_13 = KerasLayer(Parent=keras_layer_12, Alpha="0.2", mode="LeakyReLU Layer")
keras_layer_14 = KerasLayer(Parent=keras_layer_13, mode="Flatten Layer")
list_5 = ValueList({"None": 0, "ReLu": 1, "Sigmoid": 2, "Softmax": 3, "Tanh": 4}, selected="Sigmoid")
keras_layer_15 = KerasLayer(Parent=keras_layer_14, Size="1", Activator=list_5, mode="Dense Layer")
keras_model = KerasModel(Layer=keras_layer_15, Name="Discriminator", LearningRate="0.0002", Beta1="0.5")
pug_object = PugObject(keras_model)
pug_object_2 = ClusterOutput(pug_object)

# ==== cluster Cluster_2
int = ClusterInput()
int_2 = Integer(int)
int_3 = ClusterInput()
int_4 = Integer(int_3)
item = ListItem(List=int_2, Index=0, Wrap=True)  # -> Item, Item1
keras_layer = KerasLayer(Shape=int_4, mode="Input Layer")
division = Division(A=item.Item, B="4")
division_2 = Division(A=item.Item1, B="4")
multiplication = Multiplication(A=division, B=division_2, C="256")
keras_layer_2 = KerasLayer(Parent=keras_layer, Size=multiplication, mode="Dense Layer")
keras_layer_3 = KerasLayer(Parent=keras_layer_2, Momentum="0.8", mode="Batch Normalization Layer")
merge = Merge(Data1=division, Data2=division_2, Data3="256")
keras_layer_4 = KerasLayer(Parent=keras_layer_3, Alpha="0.2", mode="LeakyReLU Layer")
panel = Panel(merge)
keras_layer_5 = KerasLayer(Parent=keras_layer_4, Shape=panel, mode="Reshape Layer")
keras_layer_6 = KerasLayer(Parent=keras_layer_5, mode="UpSampling2D Layer")
list = ValueList({"valid": 0, "same": 1}, selected="same")
panel_2 = Panel("""3
3""")
keras_layer_7 = KerasLayer(Parent=keras_layer_6, Filters="128", Kernel=panel_2, Padding=list, mode="Conv2D Layer")
keras_layer_8 = KerasLayer(Parent=keras_layer_7, Momentum="0.8", mode="Batch Normalization Layer")
keras_layer_9 = KerasLayer(Parent=keras_layer_8, Alpha="0.2", mode="LeakyReLU Layer")
keras_layer_10 = KerasLayer(Parent=keras_layer_9, mode="UpSampling2D Layer")
panel_3 = Panel("""1
1""")
list_2 = ValueList({"valid": 0, "same": 1}, selected="same")
panel_4 = Panel("""3
3""")
keras_layer_11 = KerasLayer(Parent=keras_layer_10, Filters="64", Kernel=panel_4, Stride=panel_3, Padding=list_2, mode="Conv2D Layer")
keras_layer_12 = KerasLayer(Parent=keras_layer_11, Momentum="0.8", mode="Batch Normalization Layer")
keras_layer_13 = KerasLayer(Parent=keras_layer_12, Alpha="0.2", mode="LeakyReLU Layer")
list_3 = ValueList({"valid": 0, "same": 1}, selected="same")
panel_5 = Panel("""1
1""")
panel_6 = Panel("""3
3""")
keras_layer_14 = KerasLayer(Parent=keras_layer_13, Filters="32", Kernel=panel_6, Stride=panel_5, Padding=list_3, mode="Conv2D Layer")
keras_layer_15 = KerasLayer(Parent=keras_layer_14, Momentum="0.8", mode="Batch Normalization Layer")
keras_layer_16 = KerasLayer(Parent=keras_layer_15, Alpha="0.2", mode="LeakyReLU Layer")
list_4 = ValueList({"None": 0, "ReLu": 1, "Sigmoid": 2, "Softmax": 3, "Tanh": 4}, selected="Tanh")
list_5 = ValueList({"valid": 0, "same": 1}, selected="same")
panel_7 = Panel("""1
1""")
panel_8 = Panel("""3
3""")
keras_layer_17 = KerasLayer(
    Parent=keras_layer_16,
    Filters="1",
    Kernel=panel_8,
    Stride=panel_7,
    Padding=list_5,
    Activator=list_4,
    mode="Conv2D Layer")
keras_model = KerasModel(Layer=keras_layer_17, Name="Generator", LearningRate="0.0002", Beta1="0.5")
pug_object = PugObject(keras_model)
pug_object_2 = ClusterOutput(pug_object)
